# Grasshopper definition Robot Test.gh (Grasshopper 1.0.8)

roarm_simple_test = CSharpScript(IP="192.168.4.1", Execute=Toggle(False), Angle=Slider(2.3, range=0..3.1), Speed=Slider(5, range=0..10))  # -> out, a, b; inputs IP: String, Execute: Boolean, Joint: Int32, Angle: Int32, Speed: Int32
# ---------- roarm_simple_test: C# ----------
// Grasshopper C# Script Component - SIMPLE VERSION
// Based on official Waveshare format: http://{ip}/js?json={command}
// ⚠️ WARNING: This will move the arm!

#region Usings
using System;
using System.Net.Http;
using System.Text.Json;
using Rhino.Geometry;
using Grasshopper.Kernel;
#endregion

public class Script_Instance : GH_ScriptInstance
{
    private void RunScript(
		string IP,
		bool Execute,
		int Joint,
		int Angle,
		int Speed,
		ref object a,
		ref object b)
    {
        string ipAddress = string.IsNullOrEmpty(IP) ? "192.168.4.1" : IP;
        string status = "";
        object result = null;
        
        if (Execute)
        {
            try
            {
                using (HttpClient client = new HttpClient())
                {
                    client.Timeout = TimeSpan.FromSeconds(5);
                    
                    // Official format: {"T":timestamp,"m":1,"axis":axis,"cmd":value,"spd":speed}
                    long timestamp = DateTimeOffset.UtcNow.ToUnixTimeMilliseconds();
                    
                    var command = new
                    {
                        T = timestamp,
                        m = 1,
                        axis = Joint - 1,  // 0=base, 1=shoulder, 2=elbow, 3=hand
                        cmd = Angle,      // Angle value (test with small values like 1-10)
                        spd = Speed        // Speed (1-10 recommended)
                    };
                    
                    string json = JsonSerializer.Serialize(command);
                    string url = $"http://{ipAddress}/js?json={Uri.EscapeDataString(json)}";
                    
                    var response = client.GetAsync(url).Result;
                    string responseText = response.Content.ReadAsStringAsync().Result;
                    
                    if (response.IsSuccessStatusCode)
                    {
                        status = $"✓ Sent: Joint {Joint}, Angle {Angle}, Speed {Speed}";
                        result = responseText;
                    }
                    else
                    {
                        status = $"✗ HTTP {response.StatusCode}";
                    }
                }
            }
            catch (Exception ex)
            {
                status = $"✗ Error: {ex.Message}";
            }
        }
        else
        {
            status = "⏸ Execute = False";
        }
        
        a = result;
        b = status;
    }
}
# ---------- end roarm_simple_test ----------
panel = Panel(roarm_simple_test.out)
